# Grasshopper definition PtTripAdvisor.gh (Grasshopper 1.0.8)
# plug-ins: RhinoCodePluginGH, Human

number_slider = Slider(1.5, range=0..10)

# ---- group: Input
geo = Geometry(<surface referenced from the Rhino model>)
x = Panel("150")
x_2 = Panel("25")
y = Panel("18")

# ----
pipeline = GeometryPipeline(
    GroupByLayer=False,
    GroupByType=False,
    IncludeHidden=True,
    IncludeLocked=True,
    LayerFilter="points2",
    SublayerFiltering=True,
    TypeFilter=1)

Z = UnitZ(Factor=Slider(2500, range=0..10000))
neg = Negative(Value=Z)
move = Move(Geometry=pipeline, Motion=neg)  # -> Geometry, Transform
Z_2 = UnitZ(Factor=Slider(10, range=0..10))
extr = Extrude(Base=move.Geometry, Direction=Z_2)

pt = Point(pipeline)  # disabled
panel = Panel(pt)

sqgrid = Square(Plane=geo, Size=x, ExtentX=x_2, ExtentY=y)  # -> flatten(Cells), Points
area = Area(Geometry=sqgrid.Cells)  # -> Area, Centroid
merge = Merge(Data1=pipeline, Data2=area.Centroid)
pt_2 = Point(merge)
incurves = PointInCurves(Point=pt_2, Curves=sqgrid.Cells)  # -> Relationship, Index, Point
py3 = Python3Script(numbers=incurves.Index)  # -> out, simplify(a); inputs numbers: list of Int32
# ---------- py3: Python ----------
import ghpythonlib.treehelpers as th

index_dict = {}
for index, number in enumerate(numbers):
    if number not in index_dict:
        index_dict[number] = []
    index_dict[number].append(index)

# Ensure all numbers from 0 to max(numbers) are included
max_number = max(numbers)
sorted_index_lists = [index_dict.get(i, []) for i in range(max_number + 1)]

from pprint import pprint
pprint(sorted_index_lists)
pprint(index_dict)





a = th.list_to_tree(sorted_index_lists)
# ---------- end py3 ----------
tstat = TreeStatistics(Tree=py3.a)  # -> Paths, Length, Count

division = Division(A=y, B=number_slider)
division_2 = Division(A=x_2, B=number_slider)
ln = Line(StartPoint=pt, EndPoint=pt)
py3_2 = Python3Script(points=pt, radius=Slider(2000, range=0..10000))  # -> out, a; inputs points: list; disabled
# ---------- py3_2: Python ----------
import Rhino.Geometry as rg

# 输入检查
if not points or radius <= 0:
    lines = []
else:
    lines = []
    point_count = len(points)
    
    # 遍历所有点对组合
    for i in range(point_count):
        pt_i = points[i]
        for j in range(i + 1, point_count):  # 避免重复检查
            pt_j = points[j]
            
            # 计算点间距并创建连线
            if pt_i.Distance(pt_j) <= radius:
                lines.append(rg.Line(pt_i, pt_j))

# 输出结果线列表
lines = lines
# ---------- end py3_2 ----------
sdivide = DivideSurface(Surface=geo, UCount=division_2, VCount=division)  # -> flatten(Points), Normals, Parameters
geo_2 = Geometry(<curve referenced from the Rhino model>)
points = PointList(Points=area.Centroid, Size="20")
points_2 = PointList(Points=pt_2, Size="20")
crv_cp = CurveClosestPoint(Point=sdivide.Points, Curve=geo_2)  # -> Point, Parameter, flatten(Distance)

Z_3 = UnitZ(Factor=1)
pt2num = PointsToNumbers(Points=pipeline, Mask="z")  # -> simplify(Numbers)
neg_2 = Negative(Value=Z_3)
line = LineSDL(Start=pipeline, Direction=neg_2, Length=pt2num)
createatts = CreateAttributes(LayerName="Line", enableFullPath=False)
bake = BakeGeometry(Bake=Button(), Geometry=flatten(line), Attributes=createatts, DeleteOldBakes=False, PreserveTrees=False)

createatts_2 = CreateAttributes(LayerName="points on", enableFullPath=False)
smaller = SmallerThan(FirstNumber=crv_cp.Distance, SecondNumber=Slider(1, range=0..1))  # -> SmallerThan, OrEqualTo
bake_2 = BakeGeometry(Bake=Button(), Geometry=flatten(extr), Attributes=createatts_2, DeleteOldBakes=False, PreserveTrees=False)
not = GateNot(A=smaller.SmallerThan)
number_slider_2 = Slider(47, range=0..1000)
cull = CullPattern(List=sdivide.Points, CullPattern=not)
X = UnitX(Factor=1)
pt_3 = Point(cull)
Y = UnitY(Factor=1)

# ---- group: Surface Grid
# Add contrast by "streching" the numbers
bnd = Bounds(Numbers=tstat.Length)
dom = ConstructDomain(DomainStart="0", DomainEnd="2000")
remap = RemapNumbers(Value=tstat.Length, Source=bnd, Target=dom)  # -> Mapped, Clipped
Z_4 = UnitZ(Factor=remap.Mapped)
move_2 = Move(Geometry=area.Centroid, Motion=Z_4)  # -> Geometry, Transform
srfgrid = SurfaceFromPoints(Points=move_2.Geometry, UCount=x_2, Interpolate=False)

# ----
multiplication = Multiplication(A=X, B=number_slider_2)
multiplication_2 = Multiplication(A=number_slider_2, B=Y)
line_2 = LineSDL(Start=pt_3, Direction=multiplication, Length=multiplication)
line_3 = LineSDL(Start=pt_3, Direction=multiplication_2, Length=multiplication_2)
multiplication_3 = Multiplication(A=multiplication_2, B="-0.5")
multiplication_4 = Multiplication(A=multiplication, B="-0.5")
move_3 = Move(Geometry=line_3, Motion=multiplication_3)  # -> Geometry, Transform
move_4 = Move(Geometry=line_2, Motion=multiplication_4)  # -> Geometry, Transform
Z_5 = UnitZ(Factor="-5000")
move_5 = Move(Geometry=[move_4.Geometry, move_3.Geometry], Motion=Z_5)  # -> Geometry, Transform

contour = Contour(Shape=srfgrid, Point=Point(0, 0, 0), Direction=Vector(0, 0, 1), Distance="20")
eval = EvaluateCurve(Curve=contour, Parameter=0)  # -> Point, Tangent, Angle
pdecon = Deconstruct(Point=eval.Point)  # -> XComponent, YComponent, ZComponent
bnd_2 = Bounds(Numbers=flatten(pdecon.ZComponent))
dedomain = DeconstructDomain(Domain=bnd_2)  # -> Start, End
gradient = Gradient(
    LowerLimit=dedomain.Start,
    UpperLimit=dedomain.End,
    Parameter=flatten(pdecon.ZComponent),
    stops=[0: RGB(2, 108, 150), 0.232: RGB(124, 196, 192), 0.474: RGB(254, 227, 174), 1: RGB(220, 129, 108)])
preview = CustomPreview(Geometry=flatten(contour), Material=gradient)
createatts_3 = CreateAttributes(LayerName="Photos", Color=gradient, enableFullPath=False)
bake_3 = BakeGeometry(Bake=Button(), Geometry=flatten(contour), Attributes=createatts_3, DeleteOldBakes=False, PreserveTrees=False)

merge_2 = Merge(Data1=move_4.Geometry, Data2=move_3.Geometry, Data3=move_5.Geometry)
createatts_4 = CreateAttributes(LayerName="FRAME", enableFullPath=False)
bake_4 = BakeGeometry(Bake=Button(), Geometry=flatten(merge_2), Attributes=createatts_4, DeleteOldBakes=False, PreserveTrees=False)
