# Grasshopper definition contour.gh (Grasshopper 1.0.8)
# plug-ins: RhinoCodePluginGH, Human, LunchBox

panel = Panel("C:\Users\frida\Documents\Projects\visualization\Mid\Lower_Lea_Crossing-2025-03-24_15-21-50\AlignedData.csv")
panel_2 = Panel("C:\Users\frida\Documents\Projects\visualization\3.20\Lower_Lea_Crossing-2025-03-24_15-21-50\Accelerometer.csv")

# ---- group: Input
x = Panel("50")
geo = Geometry(<curve referenced from the Rhino model>)
x_2 = Panel("5")
y = Panel("18")

# ----
file = ReadFile(File=panel, PerLineParse=True)
series = Series(Start=Slider(2, range=0..10), Step=Slider(1, range=0..10), Count=Slider(3, range=0..10))
file_2 = ReadFile(File=panel_2, PerLineParse=True)
csv = ReadCSV(CSVString=file, Delimiter=",")  # -> Headers, Values
project = Project(Plane=geo)  # -> Geometry, Transform
csv_2 = ReadCSV(CSVString=file_2, Delimiter=",")  # -> Headers, Values
tstat = TreeStatistics(Tree=csv.Values)  # -> Paths, Length, Count
item = ListItem(List=tstat.Paths, Index="15", Wrap=True)
split = SplitTree(Data=csv.Values, Masks=flatten(item))  # -> Positive, Negative
item_2 = ListItem(List=tstat.Paths, Index="6", Wrap=True)
panel_3 = Panel(split.Positive)
item_3 = ListItem(List=tstat.Paths, Index=series, Wrap=True)
split_2 = SplitTree(Data=csv.Values, Masks=flatten(item_2))  # -> Positive, Negative
panel_4 = Panel(csv.Headers)
multiplication = Multiplication(A=panel_3, B=Slider(1, range=0..10))
split_3 = SplitTree(Data=csv_2.Values, Masks=flatten(item_3))  # -> Positive, Negative
panel_5 = Panel(csv_2.Headers)
Z = UnitZ(Factor=multiplication)
item_4 = ListItem(List=tstat.Paths, Index="11", Wrap=True)
panel_6 = Panel(split_2.Positive)
tstat_2 = TreeStatistics(Tree=split_3.Positive)  # -> Paths, Length, Count
split_4 = SplitTree(Data=csv.Values, Masks=flatten(item_4))  # -> Positive, Negative
panel_7 = Panel(split_4.Positive)
cluster = Cluster(L_3=tstat_2.Paths, D_3=split_3.Positive, L_2=tstat_2.Paths, D_2=split_3.Positive, L=tstat_2.Paths, D=split_3.Positive)  # -> P_3, P_2, P
lng = ListLength(List=split_3.Positive)
vec = VectorXYZ(XComponent=cluster.P_3, YComponent=cluster.P_2, ZComponent=cluster.P)  # -> Vector, Length
multiplication_2 = Multiplication(A=panel_7, B="10000")
multiplication_3 = Multiplication(A=panel_6, B="16000")
subtraction = Subtraction(A=multiplication_3, B="824070")
item_5 = ListItem(List=tstat.Paths, Index="13", Wrap=True)
pt = ConstructPoint(XCoordinate=multiplication_2, YCoordinate=subtraction, ZCoordinate=0)

sqgrid = Square(Plane=geo, Size=x_2, ExtentX=x, ExtentY=y)  # -> flatten(Cells), Points
area = Area(Geometry=sqgrid.Cells)  # -> Area, Centroid
merge = Merge(Data1=pt, Data2=area.Centroid)
pt_2 = Point(merge)
incurves = PointInCurves(Point=pt_2, Curves=sqgrid.Cells)  # -> Relationship, Index, Point
py3 = Python3Script(numbers=incurves.Index)  # -> out, simplify(a); inputs numbers: list of Int32
# ---------- py3: Python ----------
import ghpythonlib.treehelpers as th

index_dict = {}
for index, number in enumerate(numbers):
    if number not in index_dict:
        index_dict[number] = []
    index_dict[number].append(index)

# Ensure all numbers from 0 to max(numbers) are included
max_number = max(numbers)
sorted_index_lists = [index_dict.get(i, []) for i in range(max_number + 1)]

from pprint import pprint
pprint(sorted_index_lists)
pprint(index_dict)





a = th.list_to_tree(sorted_index_lists)
# ---------- end py3 ----------
tstat_3 = TreeStatistics(Tree=py3.a)  # -> Paths, Length, Count

move = Move(Geometry=pt, Motion=Z)  # -> Geometry, Transform
nurbs = NurbsCurve(Vertices=pt, Degree=3, Periodic=False)  # -> Curve, Length, Domain

# ---- group: Surface Grid
# Add contrast by "streching" the numbers
bnd = Bounds(Numbers=tstat_3.Length)
dom = ConstructDomain(DomainStart="0", DomainEnd="30")
remap = RemapNumbers(Value=tstat_3.Length, Source=bnd, Target=dom)  # -> Mapped, Clipped
Z_2 = UnitZ(Factor=remap.Mapped)
move_2 = Move(Geometry=area.Centroid, Motion=Z_2)  # -> Geometry, Transform
srfgrid = SurfaceFromPoints(Points=move_2.Geometry, UCount=x, Interpolate=False)

# ----
divide = DivideCurve(Curve=nurbs.Curve, Count=lng, Kinks=False)  # -> Points, Tangents, Parameters
split_5 = SplitTree(Data=csv.Values, Masks=flatten(item_5))  # -> Positive, Negative
item_6 = ListItem(List=tstat.Paths, Index="14", Wrap=True)
points = PointList(Points=pt, Size=Slider(0.02, range=0..0.1))
subtraction_2 = Subtraction(A=split_5.Positive, B="80")
split_6 = SplitTree(Data=csv.Values, Masks=flatten(item_6))  # -> Positive, Negative
panel_8 = Panel(split_5.Positive)
addition = Addition(A=split_6.Positive, B=Slider(70, range=0..100))
Z_3 = UnitZ(Factor=subtraction_2)
panel_9 = Panel(split_6.Positive)

dom_2 = ConstructDomain(DomainStart=Slider(20, range=0..100), DomainEnd=Slider(40, range=0..100))
bnd_2 = Bounds(Numbers=panel_9)
remap_2 = RemapNumbers(Value=panel_9, Source=bnd_2, Target=dom_2)  # -> Mapped, Clipped
Z_4 = UnitZ(Factor=remap_2.Mapped)
move_3 = Move(Geometry=pt, Motion=Z_4)  # -> Geometry, Transform
pline = PolyLine(Vertices=move_3.Geometry, Closed=False)

dom_3 = ConstructDomain(DomainStart=Slider(20, range=0..100), DomainEnd=Slider(40, range=0..100))
bnd_3 = Bounds(Numbers=panel_3)
remap_3 = RemapNumbers(Value=panel_3, Source=bnd_3, Target=dom_3)  # -> Mapped, Clipped
Z_5 = UnitZ(Factor=remap_3.Mapped)
move_4 = Move(Geometry=pt, Motion=Z_5)  # -> Geometry, Transform
pline_2 = PolyLine(Vertices=move_4.Geometry, Closed=False)

Z_6 = UnitZ(Factor=1)
move_5 = Move(Geometry=pt, Motion=Z_3)  # -> Geometry, Transform
neg = Negative(Value=Z_6)
gradient = Gradient(
    LowerLimit=0,
    UpperLimit=1,
    stops=[0: RGB(2, 108, 150), 0.232: RGB(124, 196, 192), 0.474: RGB(254, 227, 174), 1: RGB(220, 129, 108)])
line = LineSDL(Start=move_5.Geometry, Direction=neg, Length=subtraction_2)

# ---- group: Cull Pattern
number_slider = Slider(69, range=0..1974)
series_2 = Series(Start=Slider(0, range=0..100), Step=Slider(0, range=0..100), Count=Slider(10, range=0..100))
ins = InsertItems(List=series_2, Item="true", Indices=Slider(0, range=0..100), Wrap=True)
cull = CullPattern(List=move_5.Geometry, CullPattern=ins)
pline_3 = PolyLine(Vertices=cull, Closed=False)
cull_2 = CullPattern(List=line, CullPattern=ins)

# ----
number_slider_2 = Slider(-55, range=-100..0)  # disabled
pline_4 = PolyLine(Vertices=move_5.Geometry, Closed=False)
Z_7 = UnitZ(Factor=1)  # disabled
multiplication_4 = Multiplication(A=number_slider_2, B=Z_7)  # disabled

dom_4 = ConstructDomain(DomainStart=Slider(20, range=0..100), DomainEnd=Slider(40, range=0..100))
bnd_4 = Bounds(Numbers=panel_8)
remap_4 = RemapNumbers(Value=panel_8, Source=bnd_4, Target=dom_4)  # -> Mapped, Clipped
Z_8 = UnitZ(Factor=remap_4.Mapped)
move_6 = Move(Geometry=pt, Motion=Z_8)  # -> Geometry, Transform
pline_5 = PolyLine(Vertices=move_6.Geometry, Closed=False)

move_7 = Move(Motion=multiplication_4)  # -> Geometry, Transform; disabled

Z_9 = UnitZ(Factor=1)
neg_2 = Negative(Value=Z_9)
line_2 = LineSDL(Start=move_4.Geometry, Direction=neg_2, Length=remap_3.Mapped)

Z_10 = UnitZ(Factor=1)
neg_3 = Negative(Value=Z_10)
line_3 = LineSDL(Start=move_3.Geometry, Direction=neg_3, Length=remap_2.Mapped)

createatts = CreateAttributes(LayerName="SoundPoly", enableFullPath=False)
bake = BakeGeometry(Bake=Button(), Geometry=flatten(pline), Attributes=createatts, DeleteOldBakes=False, PreserveTrees=False)

createatts_2 = CreateAttributes(LayerName="SoundLine", enableFullPath=False)
bake_2 = BakeGeometry(Bake=Button(), Geometry=flatten(line_3), Attributes=createatts_2, DeleteOldBakes=False, PreserveTrees=False)

createatts_3 = CreateAttributes(LayerName="MotionPoly", enableFullPath=False)
bake_3 = BakeGeometry(Bake=Button(), Geometry=flatten(pline_2), Attributes=createatts_3, DeleteOldBakes=False, PreserveTrees=False)

createatts_4 = CreateAttributes(LayerName="MotionLine", enableFullPath=False)
bake_4 = BakeGeometry(Bake=Button(), Geometry=flatten(line_2), Attributes=createatts_4, DeleteOldBakes=False, PreserveTrees=False)

Z_11 = UnitZ(Factor=1)
neg_4 = Negative(Value=Z_11)
line_4 = LineSDL(Start=move_6.Geometry, Direction=neg_4, Length=remap_4.Mapped)

createatts_5 = CreateAttributes(LayerName="HeartPoly", enableFullPath=False)
bake_5 = BakeGeometry(Bake=Button(), Geometry=flatten(pline_5), Attributes=createatts_5, DeleteOldBakes=False, PreserveTrees=False)

createatts_6 = CreateAttributes(LayerName="HeartLine", enableFullPath=False)
bake_6 = BakeGeometry(Bake=Button(), Geometry=flatten(line_4), Attributes=createatts_6, DeleteOldBakes=False, PreserveTrees=False)

# ---- group: Input
geo_2 = Geometry(<curve referenced from the Rhino model>)
x_3 = Panel("50")
x_4 = Panel("5")
y_2 = Panel("18")

geo_3 = Geometry(<curve referenced from the Rhino model>)
x_5 = Panel("35")
x_6 = Panel("5")
y_3 = Panel("18")

geo_4 = Geometry(<curve referenced from the Rhino model>)
x_7 = Panel("5")
x_8 = Panel("50")
y_4 = Panel("18")

# ----
sqgrid_2 = Square(Plane=geo_2, Size=x_4, ExtentX=x_3, ExtentY=y_2)  # -> flatten(Cells), Points
area_2 = Area(Geometry=sqgrid_2.Cells)  # -> Area, Centroid
merge_2 = Merge(Data1=move_3.Geometry, Data2=area_2.Centroid)
pt_3 = Point(merge_2)
incurves_2 = PointInCurves(Point=pt_3, Curves=sqgrid_2.Cells)  # -> Relationship, Index, Point
py3_2 = Python3Script(numbers=incurves_2.Index)  # -> out, simplify(a); inputs numbers: list of Int32
# ---------- py3_2: Python ----------
import ghpythonlib.treehelpers as th

index_dict = {}
for index, number in enumerate(numbers):
    if number not in index_dict:
        index_dict[number] = []
    index_dict[number].append(index)

# Ensure all numbers from 0 to max(numbers) are included
max_number = max(numbers)
sorted_index_lists = [index_dict.get(i, []) for i in range(max_number + 1)]

from pprint import pprint
pprint(sorted_index_lists)
pprint(index_dict)

a = th.list_to_tree(sorted_index_lists)
# ---------- end py3_2 ----------

sqgrid_3 = Square(Plane=geo_3, Size=x_6, ExtentX=x_5, ExtentY=y_3)  # -> flatten(Cells), Points
area_3 = Area(Geometry=sqgrid_3.Cells)  # -> Area, Centroid
merge_3 = Merge(Data1=move_5.Geometry, Data2=area_3.Centroid)
pt_4 = Point(merge_3)
incurves_3 = PointInCurves(Point=pt_4, Curves=sqgrid_3.Cells)  # -> Relationship, Index, Point
py3_3 = Python3Script(numbers=incurves_3.Index)  # -> out, simplify(a); inputs numbers: list of Int32; same code as py3_2

sqgrid_4 = Square(Plane=geo_4, Size=x_7, ExtentX=x_8, ExtentY=y_4)  # -> flatten(Cells), Points
area_4 = Area(Geometry=sqgrid_4.Cells)  # -> Area, Centroid
merge_4 = Merge(Data1=move_5.Geometry, Data2=area_4.Centroid)
pt_5 = Point(merge_4)
incurves_4 = PointInCurves(Point=pt_5, Curves=sqgrid_4.Cells)  # -> Relationship, Index, Point
py3_4 = Python3Script(numbers=incurves_4.Index)  # -> out, simplify(a); inputs numbers: list of Int32; same code as py3_2

# ---- group: Surface Grid
item_7 = ListItem(List=panel_9, Index=py3_2.a, Wrap=True)
ma = MassAddition(Input=item_7)  # -> flatten(Result), PartialResults
dom_5 = ConstructDomain(DomainStart="0", DomainEnd="30")
panel_10 = Panel(ma.Result)
# Add contrast by "streching" the numbers
bnd_5 = Bounds(Numbers=panel_10)
remap_5 = RemapNumbers(Value=panel_10, Source=bnd_5, Target=dom_5)  # -> Mapped, Clipped
Z_12 = UnitZ(Factor=remap_5.Mapped)
move_8 = Move(Geometry=area_2.Centroid, Motion=Z_12)  # -> Geometry, Transform
srfgrid_2 = SurfaceFromPoints(Points=move_8.Geometry, UCount=x_3, Interpolate=False)

item_8 = ListItem(List=panel_3, Index=py3_3.a, Wrap=True)
ma_2 = MassAddition(Input=item_8)  # -> flatten(Result), PartialResults
dom_6 = ConstructDomain(DomainStart="0", DomainEnd="30")
panel_11 = Panel(ma_2.Result)
bnd_6 = Bounds(Numbers=panel_11)
remap_6 = RemapNumbers(Value=panel_11, Source=bnd_6, Target=dom_6)  # -> Mapped, Clipped
Z_13 = UnitZ(Factor=remap_6.Mapped)
move_9 = Move(Geometry=area_3.Centroid, Motion=Z_13)  # -> Geometry, Transform
srfgrid_3 = SurfaceFromPoints(Points=move_9.Geometry, UCount=x_5, Interpolate=False)

item_9 = ListItem(List=panel_8, Index=py3_4.a, Wrap=True)
ma_3 = MassAddition(Input=item_9)  # -> flatten(Result), PartialResults
dom_7 = ConstructDomain(DomainStart="0", DomainEnd="30")
panel_12 = Panel(ma_3.Result)
# Add contrast by "streching" the numbers
bnd_7 = Bounds(Numbers=panel_12)
remap_7 = RemapNumbers(Value=panel_12, Source=bnd_7, Target=dom_7)  # -> Mapped, Clipped
Z_14 = UnitZ(Factor=remap_7.Mapped)
move_10 = Move(Geometry=area_4.Centroid, Motion=Z_14)  # -> Geometry, Transform
srfgrid_4 = SurfaceFromPoints(Points=move_10.Geometry, UCount=x_8, Interpolate=False)

# ----
contour = Contour(Shape=srfgrid_2, Point=Point(0, 0, 0), Direction=Vector(0, 0, 1), Distance="0.5")
eval = EvaluateCurve(Curve=contour, Parameter=0)  # -> Point, Tangent, Angle
pdecon = Deconstruct(Point=eval.Point)  # -> XComponent, YComponent, ZComponent
bnd_8 = Bounds(Numbers=flatten(pdecon.ZComponent))
dedomain = DeconstructDomain(Domain=bnd_8)  # -> Start, End
gradient_2 = Gradient(
    LowerLimit=dedomain.Start,
    UpperLimit=dedomain.End,
    Parameter=flatten(pdecon.ZComponent),
    stops=[0: RGB(21, 145, 150), 0: RGB(255, 255, 255), 0.142: RGB(231, 236, 247), 0.468: RGB(148, 166, 202), 0.929: RGB(100, 123, 167)])
preview = CustomPreview(Geometry=flatten(contour), Material=gradient_2)
createatts_7 = CreateAttributes(LayerName="Sound", Color=gradient_2, enableFullPath=False)
bake_7 = BakeGeometry(Bake=Button(), Geometry=flatten(contour), Attributes=createatts_7, DeleteOldBakes=False, PreserveTrees=False)

contour_2 = Contour(Shape=srfgrid_3, Point=Point(0, 0, 0), Direction=Vector(0, 0, 1), Distance="0.5")
eval_2 = EvaluateCurve(Curve=contour_2, Parameter=0)  # -> Point, Tangent, Angle
pdecon_2 = Deconstruct(Point=eval_2.Point)  # -> XComponent, YComponent, ZComponent
bnd_9 = Bounds(Numbers=flatten(pdecon_2.ZComponent))
dedomain_2 = DeconstructDomain(Domain=bnd_9)  # -> Start, End
gradient_3 = Gradient(
    LowerLimit=dedomain_2.Start,
    UpperLimit=dedomain_2.End,
    Parameter=flatten(pdecon_2.ZComponent),
    stops=[0: RGB(21, 145, 150), 0: RGB(255, 255, 255), 0.117: RGB(231, 236, 247), 0.25: RGB(148, 166, 202), 0.502: RGB(100, 123, 167)])
# Add contrast by "streching" the numbers
preview_2 = CustomPreview(Geometry=flatten(contour_2), Material=gradient_3)
createatts_8 = CreateAttributes(LayerName="Motion", Color=gradient_3, enableFullPath=False)
bake_8 = BakeGeometry(Bake=Button(), Geometry=flatten(contour_2), Attributes=createatts_8, DeleteOldBakes=False, PreserveTrees=False)

contour_3 = Contour(Shape=srfgrid, Point=Point(0, 0, 0), Direction=Vector(0, 0, 1), Distance="0.5")
eval_3 = EvaluateCurve(Curve=contour_3, Parameter=0)  # -> Point, Tangent, Angle
pdecon_3 = Deconstruct(Point=eval_3.Point)  # -> XComponent, YComponent, ZComponent
bnd_10 = Bounds(Numbers=flatten(pdecon_3.ZComponent))
dedomain_3 = DeconstructDomain(Domain=bnd_10)  # -> Start, End
gradient_4 = Gradient(
    LowerLimit=dedomain_3.Start,
    UpperLimit=dedomain_3.End,
    Parameter=flatten(pdecon_3.ZComponent),
    stops=[0: RGB(231, 236, 247), 0: RGB(21, 145, 150), 0: RGB(255, 255, 255), 0.274: RGB(148, 166, 202), 0.522: RGB(100, 123, 167)])
preview_3 = CustomPreview(Geometry=flatten(contour_3), Material=gradient_4)

gradient_5 = Gradient(
    LowerLimit=dedomain_3.Start,
    UpperLimit=dedomain_3.End,
    Parameter=flatten(pdecon_3.ZComponent),
    stops=[0: RGB(21, 145, 150), 0: RGB(255, 255, 255), 0.147: RGB(186, 225, 222), 0.325: RGB(136, 194, 190), 0.526: RGB(85, 154, 149)])
gradient_6 = Gradient(
    LowerLimit=dedomain_3.Start,
    UpperLimit=dedomain_3.End,
    Parameter=flatten(pdecon_3.ZComponent),
    stops=[0: RGB(255, 255, 255), 0.0726: RGB(255, 240, 210), 0.218: RGB(255, 229, 179), 0.528: RGB(250, 212, 138)])
gradient_7 = Gradient(
    LowerLimit=dedomain_3.Start,
    UpperLimit=dedomain_3.End,
    Parameter=flatten(pdecon_3.ZComponent),
    stops=[0: RGB(163, 151, 206), 0.00443: RGB(255, 255, 255), 0.147: RGB(203, 195, 231), 0.583: RGB(119, 104, 173)])
preview_4 = CustomPreview(Geometry=flatten(contour_3), Material=gradient_5)
preview_5 = CustomPreview(Geometry=flatten(contour_3), Material=gradient_6)
preview_6 = CustomPreview(Geometry=flatten(contour_3), Material=gradient_7)

createatts_9 = CreateAttributes(LayerName="Bake", Color=gradient_6, enableFullPath=False)
bake_9 = BakeGeometry(Bake=Button(), Geometry=flatten(contour_3), Attributes=createatts_9, DeleteOldBakes=False, PreserveTrees=False)

contour_4 = Contour(Shape=srfgrid_4, Point=Point(0, 0, 0), Direction=Vector(0, 0, 1), Distance="0.5")
eval_4 = EvaluateCurve(Curve=contour_4, Parameter=0)  # -> Point, Tangent, Angle
pdecon_4 = Deconstruct(Point=eval_4.Point)  # -> XComponent, YComponent, ZComponent
bnd_11 = Bounds(Numbers=flatten(pdecon_4.ZComponent))
dedomain_4 = DeconstructDomain(Domain=bnd_11)  # -> Start, End
gradient_8 = Gradient(
    LowerLimit=dedomain_4.Start,
    UpperLimit=dedomain_4.End,
    Parameter=flatten(pdecon_4.ZComponent),
    stops=[0: RGB(21, 145, 150), 0: RGB(255, 255, 255), 0.334: RGB(231, 236, 247), 0.611: RGB(148, 166, 202), 0.964: RGB(100, 123, 167)])
preview_7 = CustomPreview(Geometry=flatten(contour_4), Material=gradient_8)
createatts_10 = CreateAttributes(LayerName="HeartRate", Color=gradient_6, enableFullPath=False)
bake_10 = BakeGeometry(Bake=Button(), Geometry=flatten(contour_4), Attributes=createatts_10, DeleteOldBakes=False, PreserveTrees=False)

# ==== cluster Cluster
L = ClusterInput()
L_2 = ClusterInput()
L_3 = ClusterInput()
item = ListItem(List=L, Index="4", Wrap=True)
item_2 = ListItem(List=L_2, Index="3", Wrap=True)
item_3 = ListItem(List=L_3, Index="2", Wrap=True)
D = ClusterInput()
D_2 = ClusterInput()
D_3 = ClusterInput()
split = SplitTree(Data=D, Masks=flatten(item))  # -> Positive, Negative
split_2 = SplitTree(Data=D_2, Masks=flatten(item_2))  # -> Positive, Negative
split_3 = SplitTree(Data=D_3, Masks=flatten(item_3))  # -> Positive, Negative
P = ClusterOutput(split.Positive)
P_2 = ClusterOutput(split_2.Positive)
P_3 = ClusterOutput(split_3.Positive)
